# Grasshopper definition COLLAB_STUDIO_G2.gh (Grasshopper 1.0.7)
# plug-ins: Kangaroo2 Components, Shortest Walk in Gh

accommodation_energy_request = Slider(0.58, range=0..1)
accommodation_food_request = Slider(0.35, range=0..1)
labs_food_request = Slider(0.47, range=0..1)
labs_energy_request = Slider(0.39, range=0..1)
seed = Slider(3, range=0..10)
labs_energy_request_2 = GetNumber(labs_energy_request, AtLeast=1, AtMost=1, Maximum=1.797693135e+308, Minimum=-1.797693135e+308, TreeAccess=False)
labs_food_request_2 = GetNumber(labs_food_request, AtLeast=1, AtMost=1, Maximum=1.797693135e+308, Minimum=-1.797693135e+308, TreeAccess=False)
accommodation_energy_request_2 = GetNumber(accommodation_energy_request, AtLeast=1, AtMost=1, Maximum=1.797693135e+308, Minimum=-1.797693135e+308, TreeAccess=False)
accommodation_food_request_2 = GetNumber(accommodation_food_request, AtLeast=1, AtMost=1, Maximum=1.797693135e+308, Minimum=-1.797693135e+308, TreeAccess=False)
general_seed = GetNumber(seed, AtLeast=1, AtMost=1, Maximum=1.797693135e+308, Minimum=-1.797693135e+308, TreeAccess=False)
triangular = Triangular(Plane=PlaneXY(0, 0, 0), Size=1, ExtentX=Slider(10, range=0..10), ExtentY=5)  # -> Cells, Points
average = Average(Input=flatten([labs_food_request_2, labs_energy_request_2, accommodation_energy_request_2, accommodation_food_request_2]))
explode = Explode(Curve=triangular.Cells, Recursive=True)  # -> flatten(Segments), flatten(Vertices)
removeduplicatepts = RemoveDuplicatePts(Points=explode.Vertices, Tolerance=0.01)
removeduplicatelines = RemoveDuplicateLines(Lines=explode.Segments, Tolerance=0.01)
number_slider = Slider(0.3, range=0..1)
sphere = Sphere(Base=removeduplicatepts, Radius=number_slider)
jitter = Jitter(List=sphere, Jitter=1, Seed=2)  # -> Values, Indices
list_length = ListLength(List=jitter.Values)
division = Division(A=list_length, B=Slider(3, range=0..10))
partition_list = PartitionList(List=jitter.Values, Size=division)  # -> simplify(Chunks)
area = Area(Geometry=partition_list)  # -> Area, Centroid
colour_swatch = ColourSwatch(SwatchColor=RGB(192, 192, 192))
colour_swatch_2 = ColourSwatch(SwatchColor=RGB(255, 193, 193))
colour_swatch_3 = ColourSwatch(SwatchColor=RGB(213, 234, 220))
explode_tree = ExplodeTree(Data=area.Centroid)  # -> Branch0, Branch1, Branch2
merge = Merge(Data1=colour_swatch_3, Data2=colour_swatch, Data3=colour_swatch_2)  # -> simplify(graft(Result))
number = Number([labs_energy_request_2, labs_food_request_2, accommodation_energy_request_2, accommodation_food_request_2])
list_length_2 = ListLength(List=explode_tree.Branch2)
subtraction = Subtraction(A=1, B=average)
list_length_3 = ListLength(List=number)
mass_addition = MassAddition(Input=number)  # -> Result, PartialResults
panel = Panel(list_length_3)
multiplication = Multiplication(A=list_length_2, B=subtraction)
random_reduce = RandomReduce(List=explode_tree.Branch2, Reduction=multiplication, Seed=general_seed)
entwine = Entwine(Branch00=explode_tree.Branch0, Branch01=explode_tree.Branch1, Branch02=random_reduce, FlattenInputs=True)
closest_point = ClosestPoint(Point=explode_tree.Branch0, Cloud=random_reduce)  # -> ClosestPoint, CPIndex, Distance
closest_point_2 = ClosestPoint(Point=explode_tree.Branch1, Cloud=random_reduce)  # -> ClosestPoint, CPIndex, Distance
point_groups = PointGroups(Points=flatten([closest_point_2.ClosestPoint, closest_point.ClosestPoint]), Distance=0.01)  # -> simplify(Groups), Indices
list_length_4 = ListLength(List=point_groups.Groups)  # -> flatten(Length)
list_item = ListItem(List=point_groups.Groups, Index=0, Wrap=True)  # -> flatten(Item)
list_length_5 = ListLength(List=list_item)
closest_point_3 = ClosestPoint(Point=explode_tree.Branch0, Cloud=explode_tree.Branch1)  # -> ClosestPoint, CPIndex, Distance
multiplication_2 = Multiplication(A=list_length_5, B=number_slider)
mass_addition_2 = MassAddition(Input=list_length_4)  # -> Result, PartialResults
remap_numbers = RemapNumbers(Value=mass_addition.Result, Source=Domain(0, 1), Target=Domain(0, 1))  # -> Mapped, Clipped
line = Line(StartPoint=explode_tree.Branch0, EndPoint=closest_point.ClosestPoint)
multiplication_3 = Multiplication(A=multiplication_2, B=list_length_4)
line_2 = Line(StartPoint=explode_tree.Branch1, EndPoint=closest_point_2.ClosestPoint)
line_3 = Line(StartPoint=explode_tree.Branch0, EndPoint=closest_point_3.ClosestPoint)
discontinuity = Discontinuity(Curve=flatten([line_3, line, line_2]), Level=1)  # -> flatten(Points), Parameters
number_slider_2 = Slider(0.05, range=0..0.1)
division_2 = Division(A=multiplication_3, B=mass_addition_2.Result)
removeduplicatepts_2 = RemoveDuplicatePts(Points=discontinuity.Points, Tolerance=0.01)
closest_point_4 = ClosestPoint(Point=entwine, Cloud=removeduplicatepts_2)  # -> ClosestPoint, CPIndex, Distance
smaller_than = SmallerThan(FirstNumber=closest_point_4.Distance, SecondNumber=0.1)  # -> SmallerThan, OrEqualTo
cull_pattern = CullPattern(List=entwine, CullPattern=smaller_than.SmallerThan)  # -> simplify(List)
explode_tree_2 = ExplodeTree(Data=cull_pattern)  # -> Branch0, Branch1, Branch2
closest_point_5 = ClosestPoint(Point=explode_tree_2.Branch2, Cloud=list_item)  # -> ClosestPoint, CPIndex, Distance
shortest_walk = ShortestWalk(Curves=removeduplicatelines, WantedPath=line)  # -> ShortestWalk, Succession, Direction, Length
shortest_walk_2 = ShortestWalk(Curves=removeduplicatelines, WantedPath=line_2)  # -> ShortestWalk, Succession, Direction, Length
list_item_2 = ListItem(List=division_2, Index=closest_point_5.CPIndex, Wrap=True)
entwine_2 = Entwine(Branch00=number_slider, Branch01=number_slider, Branch02=list_item_2, FlattenInputs=True)
sphere_2 = Sphere(Base=cull_pattern, Radius=entwine_2)
pipe = Pipe(Curve=line_3, Radius=number_slider_2, Caps=0)
pipe_2 = Pipe(Curve=shortest_walk_2.ShortestWalk, Radius=number_slider_2, Caps=0)
pipe_3 = Pipe(Curve=shortest_walk.ShortestWalk, Radius=number_slider_2, Caps=0)
colour_swatch_4 = ColourSwatch(SwatchColor=RGB(255, 255, 227))
entwine_3 = Entwine(Branch00=pipe, Branch01=pipe_3, Branch02=pipe_2, FlattenInputs=True)  # -> simplify(Result)
entwine_4 = Entwine(Branch00=colour_swatch_4, Branch01=colour_swatch_3, Branch02=colour_swatch, FlattenInputs=True)

merge_2 = Merge(Data1=colour_swatch_4, Data2=colour_swatch_3, Data3=colour_swatch, Data4=colour_swatch_2)  # -> simplify(graft(Result))
explode_tree_3 = ExplodeTree(Data=merge_2)  # -> Branch0, Branch1, Branch2, Branch3
panel_2 = Panel(explode_tree_3.Branch3)
panel_3 = Panel(explode_tree_3.Branch0)
panel_4 = Panel(explode_tree_3.Branch1)
panel_5 = Panel(explode_tree_3.Branch2)

mesh_colours = MeshColours(Mesh=sphere_2, Colours=merge)  # -> flatten(Mesh)
mesh_colours_2 = MeshColours(Mesh=entwine_3, Colours=entwine_4)  # -> flatten(Mesh)
custom_preview = CustomPreview(Geometry=entwine_3, Material=entwine_4)
custom_preview_2 = CustomPreview(Geometry=sphere_2, Material=merge)
merge_3 = Merge(Data1=mesh_colours, Data2=mesh_colours_2)
context_bake = ContextBake(Geometry=merge_3)
